# Grasshopper definition main.gh (Grasshopper 1.0.8)

facade_type = ValueList({"One": 1, "Two": 2, "Three": 3}, selected="One")

# ---- group: sample
geometry = Geometry(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)
geometry_2 = Geometry(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)

# ----
facadegenerator = Python3Script(
    script=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,
    building_brep=geometry,
    floor_height=Slider(3, range=0..10),
    pattern_length=Slider(5, range=0..10),
    pattern_ratio=Slider(0.4, range=0.1..0.9),
    pattern_depth=Slider(1.4, range=0.1..2),
    pattern_type=facade_type)  # -> out, walls, glasses, frames; inputs building_brep: Brep, floor_height: Double, pattern_type: Int32; unedited script template
python_3_script = Python3Script()  # -> out, a; unedited script template

geometry_3 = Geometry(facadegenerator.glasses)
geometry_4 = Geometry(facadegenerator.walls)

geometry_5 = Geometry(facadegenerator.frames)
custom_preview = CustomPreview(Geometry=geometry_4, Material=ColourSwatch(SwatchColor=RGB(0, 64, 255)))
custom_preview_2 = CustomPreview(Geometry=geometry_3, Material=ColourSwatch(SwatchColor=RGB(161, 161, 161)))
custom_preview_3 = CustomPreview(Geometry=geometry_5, Material=ColourSwatch(SwatchColor=RGB(94, 94, 94)))
